# Grasshopper definition Firefly_test_idea_5.gh (Grasshopper 1.0.7)
# plug-ins: Firefly.X, Bifocals

sound_capture = SoundCapture(TimePeriod=Slider(0.02, range=0..0.1), StartStopSoundCapture=Toggle(True))  # -> WavePressureSamplesFromLeftChannel, WavePressureSamplesFromRightChannel, Volume
timer = Timer(TimerInterval=20, Target=sound_capture)
data_recorder = DataRecorder(sound_capture.Volume, DataLimit=12, RecordData=True)
multiplication = Multiplication(A=data_recorder, B=Slider(0.528, range=0.02..5))
sphere = Sphere(Base=PlaneXY(0, 0, 0), Radius=Slider(49, range=0..100))
populate_geometry = PopulateGeometry(Geometry=sphere, Count=100, Seed=1)
scale = Scale(Geometry=populate_geometry, Center=Point(0, 0, 0), Factor=multiplication)  # -> Geometry, Transform
proximity_3d = Proximity3D(Points=scale.Geometry, Group=5)  # -> Links, Topology
end_points = EndPoints(Curve=proximity_3d.Links)  # -> Start, End
point = Point(end_points.Start)
surface_from_points = SurfaceFromPoints(Points=flatten(end_points.Start), UCount=expr("x=1", 12000), Interpolate=False)
